# Grasshopper definition Connect.gh (Grasshopper 1.0.7)

panel = Panel("""120
240""")
panel_2 = Panel("""15
30""")
panel_3 = Panel("""10
20""")

panel_4 = Panel("""120
240""")
panel_5 = Panel("""4
4""")
panel_6 = Panel("""200
400""")

panel_7 = Panel("""Beam
Beam""")
panel_8 = Panel("""0.5
0.65""")
panel_9 = Panel("""1
3""")

input = GhPythonScript(L=panel, t=panel_2, Lc=panel_3, Pu=panel_4, Mu=panel_6, Vu=panel_5, e_idx=panel_9, Type=panel_7, ec_max=panel_8)  # -> out; inputs L: list, t: list, Lc: list, Pu: list, Mu: list, Vu: list, e_idx: list, Type: list, ec_max: list
# ---------- input: Python ----------
__author__ = "pitipatw"
__version__ = "2023.03.10"

import rhinoscriptsyntax as rs
import ghpythonlib.treehelpers as th
import json

# assign static values

n = len(Pu)
keys = ["L", "t","Lc", "pu","mu","vu","e_idx", "type", "ec_max"]
inputs= [L,t,Lc,Pu,Mu,Vu,e_idx,Type,ec_max]

output = [None] * n
for i in range(n):
    d = dict() 
    for j in range(9):
        d[keys[j]] = inputs[j][i]
    output[i] = d
print(json.dumps(output))
#    d["pu"] = Pu[i]
#    d["mu"] = Mu[i]
#    d["vu"] = Vu[i]
#    d["e_idx"] = e_idx[i]
#    d["t"]  =  Type[i]
#    d["ec_max"] = ec_max[i]
#    
#    output[i] = d
#    
#print(json.dumps(output))
# ---------- end input ----------
panel_10 = Panel(input)
server_port = Panel("ws://127.0.0.1:2000/")
websocket_client_start = WebsocketClientStart(Address=server_port, InitalMessage=input, Reset=Button())
websocket_client_receiver = WebsocketClientReceiver(WebsocketObjects=websocket_client_start, AutoUpdate=True)  # -> Message, Status
python = GhPythonScript(input=websocket_client_receiver.Message)  # -> out, optimum, fc_prime, area_steel, fpe, ec
# ---------- python: Python ----------
__author__ = "pitipatw"
__version__ = "2023.01.24"

import rhinoscriptsyntax as rs
import ghpythonlib.treehelpers as th
import json
import Grasshopper as gh


def listToTree(nestedList): 
    dt = gh.DataTree[object]()
    for i,l in enumerate(nestedList): 
        dt.AddRange(l,gh.Kernel.Data.GH_Path(i))
    return dt



data = json.loads(input)
n1 = len(data) 



#turn each list into smaller list
fc_prime   = [ [] for ii in range(n1) ] 
area_steel = [ [] for ii in range(n1) ] 
ec         = [ [] for ii in range(n1) ] 
fpe        = [ [] for ii in range(n1) ] 
for i in range(n1):
    n2 = len(data[i])
    print(n2)
    temp_fc_prime   = [ [] for jj in range(n2) ] 
    temp_area_steel = [ [] for jj in range(n2) ] 
    temp_ec         = [ [] for jj in range(n2) ] 
    temp_fpe        = [ [] for jj in range(n2) ] 
    for j in range(n2):
        temp_fc_prime[j]   = data[i][j]["fc"]
        temp_area_steel[j] = data[i][j]["as"]
        temp_ec[j]         = data[i][j]["ec"]
        temp_fpe[j]        = data[i][j]["fpe"]
    fc_prime[i]   = temp_fc_prime
    area_steel[i] = temp_area_steel
    ec[i]         = temp_ec
    fpe[i]        = temp_fpe
    


fc_prime   = listToTree(fc_prime)
area_steel = listToTree(area_steel)
ec         = listToTree(ec)
fpe        = listToTree(fpe)
# ---------- end python ----------
rec = Rectangle()
python_2 = GhPythonScript(input=websocket_client_receiver.Message)  # -> out, optimum, all
# ---------- python_2: Python ----------
__author__ = "pitipatw"
__version__ = "2023.01.24"

import rhinoscriptsyntax as rs
import ghpythonlib.treehelpers as th
import json



data = json.loads(input)
optimum = data["optimum"]



n = len(data["all"])
#turn each list into smaller list
fc_prime   = [None] * n
area_steel = [None] * n
ec         = [None] * n
fpe        = [None] * n
for i in range(n):
    fc_prime[i]   = data[i]["fc_prime"]
    area_steel[i] = data[i]["as"]
    ec[i]         = data[i]["ec"]
    fpe[i]        = data[i]["fpe"]
# ---------- end python_2 ----------
graft = GraftTree(Tree=python.fc_prime, IncludeEmptyLists=True, IncludeNullItems=True)
graft_2 = GraftTree(Tree=python.area_steel, IncludeEmptyLists=True, IncludeNullItems=True)
graft_3 = GraftTree(Tree=python.fpe, IncludeEmptyLists=True, IncludeNullItems=True)
graft_4 = GraftTree(Tree=python.ec, IncludeEmptyLists=True, IncludeNullItems=True)
merge = Merge(Data1=graft, Data2=graft_2, Data3=graft_3, Data4=graft_4)
viewer = ParamViewer(merge)

# ---- group: Section Selector
number_slider = Slider(0, range=0..200)

# ----
panel_11 = Panel(merge)
dpath = DeconstructPath(Branch=viewer)  # -> simplify(Indices)
panel_12 = Panel(dpath)
item = ListItem(List=dpath, Index=0, Wrap=True)  # -> flatten(Item)
equals = Equality(FirstNumber=item, SecondNumber=number_slider)  # -> Equality, Inequality
panel_13 = Panel(item)
cull = CullPattern(List=viewer, CullPattern=equals.Equality)
panel_14 = Panel(equals.Equality)
branch = TreeBranch(Tree=merge, Path=cull, MaintainPaths=True)
panel_15 = Panel(branch)
